# Grasshopper definition huldiff_debug.gh (Grasshopper 1.0.7)
# plug-ins: DigitalCircularityToolkit, Human

mesh = Mesh([<mesh referenced from the Rhino model> x32])
mesh_2 = Mesh([<mesh referenced from the Rhino model> x33])
obj = Object(Geometry=mesh, NumSamples=50)
obj_2 = Object(Geometry=mesh_2, NumSamples=50)
dmhull3d = HullDifference3D(Demand=obj, Supply=obj_2, Factor="1000")
dmhull2d = HullDifference2D(Demand=obj, Supply=obj_2, Factor="1000")
objprops = ObjectProperties(Object=obj)  # -> Centroid, PCA1, PCA2, PCA3, Length, Width, Height, BoundingBox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
objprops_2 = ObjectProperties(Object=obj_2)  # -> Centroid, PCA1, PCA2, PCA3, Length, Width, Height, BoundingBox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
panel = Panel(dmhull3d)
hungarian = Hungarian(DistanceMatrix=dmhull3d)  # -> Assignment, Cost
item = ListItem(List=obj_2, Index=hungarian.Assignment, Wrap=True)
preview = CustomPreview(Geometry=objprops_2.Geometry, Material=ColourSwatch(SwatchColor=RGB(0, 204, 255)))
preview_2 = CustomPreview(Geometry=objprops.Geometry, Material=ColourSwatch(SwatchColor=RGB(255, 255, 255)))
matchlines = MatchLines(DemandPoints=objprops.Centroid, SupplyPoints=objprops_2.Centroid, AssignmentIndices=hungarian.Assignment)
alignobj = AlignToObject(SourceObject=item, TargetObject=obj)  # -> Object, Geometry, Transform
preview_3 = CustomPreview(Geometry=alignobj.Geometry, Material=ColourSwatch(SwatchColor=RGBA(0, 204, 255, 128)))
previewlw = CustomPreviewLineweights(Geometry=matchlines, Shader=ColourSwatch(SwatchColor=RGBA(0, 204, 255, 128)), Absolute=False)
