# Grasshopper definition hulltesting_script.gh (Grasshopper 1.0.7)
# plug-ins: DigitalCircularityToolkit

pt = Point([<point referenced from the Rhino model> x1240])
pointcloud = ToPointCloud(Points=pt)
crv = Curve(<curve referenced from the Rhino model>)
brep = Brep(<brep referenced from the Rhino model>)
mesh = Mesh(<mesh referenced from the Rhino model>)
obj = Object(Geometry=brep, NumSamples=50)
obj_2 = Object(Geometry=mesh, NumSamples=50)
objinfo = ObjectInformation(Object=obj_2)  # -> Centroid, PCA1, PCA2, PCA3, Length, Width, Height, BoundingBox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
objinfo_2 = ObjectInformation(Object=obj)  # -> Centroid, PCA1, PCA2, PCA3, Length, Width, Height, BoundingBox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
hull3d = VolumeHull(Object=obj, PlanarTolerance=0.0001)
alignobj = AlignToObject(SourceObject=obj, TargetObject=obj_2)  # -> Object, Geometry, Transform
brep_2 = Brep(<brep referenced from the Rhino model>)
brep_3 = Brep(<brep referenced from the Rhino model>)
sint = SolidIntersection(BrepsA=brep_2, BrepsB=brep_3)
volume = Volume(Geometry=sint)  # -> Volume, Centroid
volume_2 = Volume(Geometry=brep_2)  # -> Volume, Centroid
volume_3 = Volume(Geometry=brep_3)  # -> Volume, Centroid
panel = Panel(volume_3.Volume)
panel_2 = Panel(volume_2.Volume)
panel_3 = Panel(volume.Volume)
division = Division(A=volume.Volume, B=volume_2.Volume)
division_2 = Division(A=volume.Volume, B=volume_3.Volume)
panel_4 = Panel(division_2)
panel_5 = Panel(division)
