# Grasshopper definition objects_script.gh (Grasshopper 1.0.7)
# plug-ins: DigitalCircularityToolkit, Human

brep = Brep(<brep referenced from the Rhino model>)
popgeo = PopulateGeometry(Geometry=brep, Count=Slider(100, range=100..500), Seed=1)
crv = Curve(<curve referenced from the Rhino model>)
mesh = Mesh(<mesh referenced from the Rhino model>)
Y = UnitY(Factor=Slider(500, range=500..3000))
pt = Point(popgeo)
obj = Object_GH(Geometry=brep, NumSamples=50, PCAOverride=Vector(0, 0, 0))
move = Move(Geometry=pt, Motion=Y)  # -> Geometry, Transform
rotate = RotateObject(Object=obj, RotationAxis=2, RotationDegrees=Slider(0, range=0..360))  # -> RotatedObject, RotatedGeometry
objpts = PointBasedObject(Points=move.Geometry, PCAOverride=Vector(0, 0, 0))
objinfo = ObjectInformation(Object=rotate.RotatedObject)  # -> Centroid, PCA1, PCA2, PCA3, Length, Width, Height, BoundingBox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
pointcloud = ToPointCloud(Points=move.Geometry)
geo = Geometry(objinfo.AlignedGeometry)
box = Box(objinfo.BoundingBox)
multiplication = Multiplication(A=objinfo.Length, B=Slider(0.6, range=0..1))
line = LineSDL(Start=objinfo.Centroid, Direction=objinfo.PCA1, Length=multiplication)
line_2 = LineSDL(Start=objinfo.Centroid, Direction=objinfo.PCA2, Length=multiplication)
line_3 = LineSDL(Start=objinfo.Centroid, Direction=objinfo.PCA3, Length=multiplication)
preview = CustomPreview(Geometry=geo, Material=ColourSwatch(SwatchColor=RGBA(187, 255, 105, 137)))
number_slider = Slider(4, range=1..4)
previewlw = CustomPreviewLineweights(Geometry=line, Shader=ColourSwatch(SwatchColor=RGB(250, 0, 0)), Thickness=number_slider, Absolute=False)
previewlw_2 = CustomPreviewLineweights(Geometry=line_2, Shader=ColourSwatch(SwatchColor=RGB(0, 54, 250)), Thickness=number_slider, Absolute=False)
previewlw_3 = CustomPreviewLineweights(Geometry=line_3, Shader=ColourSwatch(SwatchColor=RGB(0, 250, 21)), Thickness=number_slider, Absolute=False)
