# Grasshopper definition radialsig_script.gh (Grasshopper 1.0.7)
# plug-ins: DigitalCircularityToolkit

pt = Point([<point referenced from the Rhino model> x1240])
mesh = Mesh([<mesh referenced from the Rhino model> x65])
pointcloud = ToPointCloud(Points=pt)
obj = Object(Geometry=mesh, NumSamples=50)
objprops = ObjectProperties(Object=obj)  # -> Centroid, PCA1, PCA2, PCA3, Length, Width, Height, BoundingBox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
crv = Curve(<curve referenced from the Rhino model>)
brep = Brep([<brep referenced from the Rhino model> x148])
radialsig = RadialSignature(Curve=<missing>, NumSamples=<missing>)  # -> Signature, Centroid
mesh_2 = MeshBrep(
    Brep=brep,
    Settings={GridMaxCount=0, GridMinCount=16, JaggedSeams=False, MaxEdgeLength=0, MinEdgeLength=0.0001, MinTolerance=0, Refine=True, RefineAngle=0, RelativeTolerance=0.65, SimplePlanes=True, Tolerance=0})
mshadow = MeshShadow(Light=Vector(0, 0, -1), Plane=PlaneXY(0, 0, 0))
crv_2 = Curve(mshadow)
join = JoinCurves(Curves=crv_2, Preserve=False)  # -> flatten(Curves)
radialsigcomplex = RadialSignatureComplex(Curve=join, NumSamples=Slider(48, range=20..100))  # -> ComplexSignature, DistanceSignature, ProjectedCurve, Rays
item = ListItem(List=radialsigcomplex.Rays, Index=Slider(13, range=0..30), Wrap=True)
panel = Panel(radialsigcomplex.ComplexSignature)
panel_2 = Panel(radialsigcomplex.DistanceSignature)
len = Length(Curve=item)
panel_3 = Panel(len)
graph = QuickGraph(radialsigcomplex.DistanceSignature, SortOrder=0)
