# Grasshopper definition rocksandsticks_script.gh (Grasshopper 1.0.7)
# plug-ins: DigitalCircularityToolkit

brep = Brep([<brep referenced from the Rhino model> x52])
mesh = Mesh([<mesh referenced from the Rhino model> x65])
brep_2 = Brep(<brep referenced from the Rhino model>)
obj = Object(Geometry=brep, NumSamples=50)
boxobj = BoxObject(Geometry=mesh, NumSamples=50, Quantity=1, LengthBuffer=1, WidthBuffer=1, HeightBuffer=1)  # -> Object, EffectiveBox
panel = Panel("-1")
objprops = ObjectProperties(Object=obj)  # -> Centroid, PCA1, PCA2, PCA3, Length, Width, Height, BoundingBox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
boxset = BoxSet(Objects=boxobj.Object)  # -> EffectiveBox, Plane, EffectiveLength, EffectiveWidth, EffectiveHeight, Indexer, Objects, Centroids, Hulls
wires = BrepWireframe(Brep=brep_2, Density=Slider(3, range=1..20))
pt = Point(objprops.SampledPoints)
lng = ListLength(List=objprops.SampledPoints)
boxscore = BoxScore(BoxObject=boxset.Objects)
item = ListItem(List=wires, Index=Slider(5, range=0..60), Wrap=True)
panel_2 = Panel(lng)
panel_3 = Panel(boxscore)
wires_2 = BrepWireframe(Brep=brep, Density=Slider(5, range=1..100))
