# Grasshopper definition utilities_script.gh (Grasshopper 1.0.7)
# plug-ins: DigitalCircularityToolkit

mesh = Mesh(<mesh referenced from the Rhino model>)
crv = Curve(<curve referenced from the Rhino model>)
brep = Brep(<brep referenced from the Rhino model>)
obj = Object(Geometry=mesh, NumSamples=50, PCAOverride=Vector(0, 0, 0))
obj_2 = Object(Geometry=brep, NumSamples=50, PCAOverride=Vector(0, 0, 0))
objinfo = ObjectInformation(Object=obj)  # -> Centroid, PCA1, PCA2, PCA3, Length, Width, Height, BoundingBox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
objinfo_2 = ObjectInformation(Object=obj_2)  # -> Centroid, PCA1, PCA2, PCA3, Length, Width, Height, BoundingBox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
geo = Geometry(objinfo_2.AlignedGeometry)
geo_2 = Geometry(objinfo.AlignedGeometry)
